# Grasshopper definition 01_long_running_tasks.gh (Grasshopper 1.0.8)

example_task = Script()  # -> do_something
# ---------- example_task: Python ----------
# r: compas_fab, compas_timber, compas_eve
# venv: eic

import time
import random
import Rhino.Geometry as rg

def do_something(worker):
    result = []

    for i in range(100):
        x, y = random.randint(0, 100), random.randint(0, 100)
        result.append(rg.Point3d(x, y, 0))
        worker.update_result(result)
        worker.display_progress(len(result) / 100)
        time.sleep(0.01)

    worker.display_message("Done!")

    return result
# ---------- end example_task ----------

eve_lrt = Script(task=example_task, reset=Button(), on=Toggle(True))  # -> result; inputs on: Boolean
# ---------- eve_lrt: Python ----------
# r: compas_fab, compas_timber, compas_eve
# venv: eic

"""
Background Task component.

Executes a long-running task in the background, while keeping Grasshopper reactive.

COMPAS EVE v1.0.0
"""

import threading
import scriptcontext as sc

from compas_eve.ghpython import BackgroundWorker
import Grasshopper

DEBUG = False


class BackgroundTaskComponent(Grasshopper.Kernel.GH_ScriptInstance):
    def RunScript(self, task, reset, on: bool):
        if not on:
            BackgroundWorker.stop_instance_by_component(ghenv)  # noqa: F821
            return None

        self.worker = BackgroundWorker.instance_by_component(ghenv, task, force_new=reset)  # noqa: F821

        if not self.worker.is_working() and not self.worker.is_done() and reset:
            self.worker.start_work()

        print("Worker ID: {}".format(id(self.worker)))
        print("Is worker running? {}".format(self.worker.is_working()))
        print("Worker completed? {}".format(self.worker.is_done()))
        if hasattr(self.worker, "thread"):
            print("Worker thread: {}".format(self.worker.thread))

        if DEBUG:
            other_workers = []
            for key in sc.sticky.keys():
                if key.startswith("background_worker_"):
                    worker = sc.sticky[key]
                    if worker != self.worker:
                        other_workers.append(worker)

            if len(other_workers):
                print
                print("Found {} more workers:".format(len(other_workers)))
                for worker in other_workers:
                    print("* Worker ID: {}".format(id(worker)))
                    print(" - Is worker running? {}".format(worker.is_working()))
                    print(" - Worker completed? {}".format(worker.is_done()))
                    print(" - Worker thread: {}".format(worker.thread))

            non_main_threads = [thread for thread in threading.enumerate() if thread.name != "MainThread"]
            if len(non_main_threads):
                print
                print("Found {} background threads running:".format(len(non_main_threads)))
                for thread in non_main_threads:
                    print(" - " + thread.name)

        if hasattr(self.worker, "result"):
            return self.worker.result
        else:
            return None
# ---------- end eve_lrt ----------
panel = Panel(eve_lrt)
pie_chart = PieChart(eve_lrt)
