# Grasshopper definition 02_distributed_events.gh (Grasshopper 1.0.8)

# ----
# Subscriber
panel = Panel("broker.emqx.io")
mqtt = MQTT(host=panel, connect=Toggle(False))  # -> mqtt_transport, is_connected; inputs host: String, port: Int32, connect: Boolean
# ---------- mqtt: Python ----------
# r: compas_fab, compas_timber, compas_eve
# venv: eic

"""
Connect or disconnect to an MQTT broker.

COMPAS EVE v1.0.0
"""

from compas_eve.mqtt import MqttTransport

from threading import Event
from scriptcontext import sticky as st

import System
import Rhino
import Grasshopper

class MqttConnectComponent(Grasshopper.Kernel.GH_ScriptInstance):
    def RunScript(self, host: str, port: int, connect: bool):
        mqtt_transport = None

        host = host or "127.0.0.1"
        port = port or 1883

        key = f"mqtt_transport_{ghenv.Component.InstanceGuid}"
        mqtt_transport = st.get(key, None)

        if mqtt_transport:
            st[key].close()

        if connect:
            event = Event()
            transport = MqttTransport(host, port)
            transport.on_ready(event.set)
            if not event.wait(5):
                raise Exception("Failed to connect to MQTT broker.")

            st[key] = transport

        mqtt_transport = st.get(key, None)
        is_connected = mqtt_transport._is_connected if mqtt_transport else False
        return (mqtt_transport, is_connected)
# ---------- end mqtt ----------
subscribe = Subscribe(transport=mqtt.mqtt_transport, topic_name="/compas_eve/hello_world/", start=Button(), on=Toggle(True))  # -> message
# ---------- subscribe: Python ----------
# r: compas_fab, compas_timber, compas_eve
# venv: eic

import System
import Rhino
import Grasshopper

from compas_eve import Topic
from compas_eve import Subscriber
from compas_eve.ghpython import BackgroundWorker

class SubscribeComponent(Grasshopper.Kernel.GH_ScriptInstance):
    def RunScript(self, transport, topic_name, start, on):
        if not topic_name:
            raise ValueError("Please specify the name of the topic")

        if on is None:
            on = True

        if not on:
            BackgroundWorker.stop_instance_by_component(ghenv)  # noqa: F821
            return None

        args = (
            transport,
            topic_name,
        )

        self.worker = BackgroundWorker.instance_by_component(
            ghenv,  # noqa: F821
            self.start_subscriber,
            dispose_function=self.stop_subscriber,
            force_new=start,
            auto_set_done=False,
            args=args,
        )

        if not self.worker.is_working() and not self.worker.is_done() and start:
            self.worker.start_work()

        if hasattr(self.worker, "result"):
            return self.worker.result
        else:
            return None

    def start_subscriber(self, worker, transport, topic_name):
        worker.count = 0

        def received_message(message):
            worker.count += 1
            worker.display_message("Received {} messages".format(worker.count))
            worker.update_result(message, 10)

        topic = Topic(topic_name)
        worker.subscriber = Subscriber(topic, callback=received_message, transport=transport)
        worker.subscriber.subscribe()
        worker.display_message("Subscribed")

    def stop_subscriber(self, worker):
        if hasattr(worker, "subscriber"):
            worker.subscriber.unsubscribe()
        worker.display_message("Stopped")
# ---------- end subscribe ----------
panel_2 = Panel(subscribe)

# ----
# Publisher
panel_3 = Panel("broker.emqx.io")
mqtt_2 = MQTT(host=panel_3, connect=Toggle(False))  # -> mqtt_transport, is_connected; inputs host: String, port: Int32, connect: Boolean; same code as mqtt
script = Script(x=Slider(0.866, range=0.1..1), y=Slider(0.748, range=0.1..1))  # -> message
# ---------- script: Python ----------
"""
Create a message.

COMPAS EVE v1.0.0
"""

import System

import Rhino.Geometry as rg
import rhinoscriptsyntax as rs

from compas.geometry import Brep
from compas_eve import Message
from compas_rhino import conversions

component = ghenv.Component  # noqa: F821

local_values = locals()
data = dict()

for input_param in component.Params.Input:
    name = input_param.NickName
    value = local_values[name]
    if isinstance(value, System.Guid):
        try:
            value = rs.coercegeometry(value)
        except:  # noqa: E722
            pass
    if isinstance(value, rg.Point3d):
        value = conversions.point_to_compas(value)
    elif isinstance(value, rg.Box):
        value = conversions.box_to_compas(value)
    elif isinstance(value, rg.Vector3d):
        value = conversions.vector_to_compas(value)
    elif isinstance(value, rg.Arc):
        value = conversions.arc_to_compas(value)
    elif isinstance(value, rg.Circle):
        value = conversions.circle_to_compas(value)
    elif isinstance(value, rg.Curve):
        value = conversions.curve_to_compas(value)
    elif isinstance(value, rg.Cone):
        value = conversions.cone_to_compas(value)
    elif isinstance(value, rg.Cylinder):
        value = conversions.cylinder_to_compas(value)
    elif isinstance(value, rg.Line):
        value = conversions.line_to_compas(value)
    elif isinstance(value, rg.Mesh):
        value = conversions.mesh_to_compas(value)
    elif isinstance(value, rg.Plane):
        value = conversions.plane_to_compas_frame(value)
    elif isinstance(value, rg.Sphere):
        value = conversions.sphere_to_compas(value)
    elif isinstance(value, rg.PolylineCurve):
        value = conversions.polygon_to_compas(value)
    elif isinstance(value, rg.Polyline):
        value = conversions.polyline_to_compas(value)
    elif isinstance(value, rg.Surface):
        value = conversions.surface_to_compas(value)
    elif isinstance(value, rg.Brep):
        value = Brep.from_native(value)

    data[name] = value

message = Message(**data)
# ---------- end script ----------
publish = Publish(transport=mqtt_2.mqtt_transport, topic_name="/compas_eve/hello_world/", message=script, on=Toggle(True))  # -> count
# ---------- publish: Python ----------
# r: compas_fab, compas_timber, compas_eve
# venv: eic
import time

import System
import Rhino
import Grasshopper

from compas_eve import Topic
from compas_eve import Publisher

from scriptcontext import sticky as st

class PublishComponent(Grasshopper.Kernel.GH_ScriptInstance):
    def RunScript(self, transport, topic_name, message, on):
        if not topic_name:
            raise ValueError("Please specify the name of the topic")

        if on is None:
            on = True

        key = f"publisher_{id(transport)}"
        key_count = f"publisher_count_{id(transport)}"
        publisher = st.get(key, None)

        if not publisher:
            topic = Topic(topic_name)
            publisher = Publisher(topic, transport=transport)
            publisher.advertise()
            time.sleep(0.2)

            st[key] = publisher
            st[key_count] = 0

        if on and message:
            st[key_count] += 1
            publisher.publish(message)
            self.Message = "Published {} messages".format(st[key_count])

        return st[key_count]
# ---------- end publish ----------
