# Grasshopper definition 01_robot_fk.gh (Grasshopper 1.0.8)

# ---- group: Robot
load = Script()  # -> robot
# ---------- load: Python ----------
# r: compas_fab, compas_timber, compas_eve
# venv: eic

import os

from compas.scene import Scene

from compas_robots import RobotModel
from compas_robots.resources import LocalPackageMeshLoader

from compas_fab.robots import Robot

canvas = ghenv.Component.OnPingDocument()
current_folder = os.path.join(os.path.dirname(canvas.FilePath))

# 1. Create robot model from URDF
# [..ADD YOUR CODE HERE..]

# 2. Load geometry using the local package mesh loader
# [..ADD YOUR CODE HERE..]

# 3. Create scene object
# [..ADD YOUR CODE HERE..]

# 4. Create robot
# [..ADD YOUR CODE HERE..]
# ---------- end load ----------

# ---- group: IK
merge = Merge(
    Data1=Slider(1.948, range=-3.142..3.142),
    Data2=Slider(-1.131, range=-3.142..3.142),
    Data3=Slider(1.194, range=-3.142..3.142),
    Data4=Slider(0, range=-3.142..3.142),
    Data5=Slider(0, range=-3.142..3.142),
    Data6=Slider(0, range=-3.142..3.142))
fk = Script(robot=load, joints=merge)  # -> config; inputs joints: list
# ---------- fk: Python ----------
# r: compas_fab, compas_timber, compas_eve
# venv: eic

# 1. Create a zero config and assign joint values
# [..ADD YOUR CODE HERE..]
# ---------- end fk ----------

# ---- group: VISUALIZATION
visualize = Script(robot=load, config=fk)  # -> out, a
# ---------- visualize: Python ----------
# r: compas_fab, compas_timber, compas_eve
# venv: eic

# 1. If config is set, update the robot
# [..ADD YOUR CODE HERE..]

# 2. Draw visual elements
# [..ADD YOUR CODE HERE..]
# ---------- end visualize ----------
