# Grasshopper definition 01_robot_fk_solution.gh (Grasshopper 1.0.8)

# ---- group: Robot
load = Script()  # -> robot
# ---------- load: Python ----------
# r: compas_fab, compas_timber, compas_eve
# venv: eic

import os

from compas.scene import Scene

from compas_robots import RobotModel
from compas_robots.resources import LocalPackageMeshLoader

from compas_fab.robots import Robot

canvas = ghenv.Component.OnPingDocument()
current_folder = os.path.join(os.path.dirname(canvas.FilePath))

# 1. Create robot model from URDF
model = RobotModel.from_urdf_file(f"{current_folder}/ur10e.urdf")

# 2. Load geometry using the local package mesh loader
model.load_geometry(LocalPackageMeshLoader(f"{current_folder}/universal_robot", "ur_description"))

# 3. Create scene object
scene = Scene()
scene_object = scene.add(model)

# 4. Create robot
robot = Robot(model, scene_object)
# ---------- end load ----------

# ---- group: IK
merge = Merge(
    Data1=Slider(1.948, range=-3.142..3.142),
    Data2=Slider(-1.131, range=-3.142..3.142),
    Data3=Slider(1.194, range=-3.142..3.142),
    Data4=Slider(0, range=-3.142..3.142),
    Data5=Slider(0, range=-3.142..3.142),
    Data6=Slider(0, range=-3.142..3.142))
fk = Script(robot=load, joints=merge)  # -> config; inputs joints: list
# ---------- fk: Python ----------
# r: compas_fab, compas_timber, compas_eve
# venv: eic

# 1. Create a zero config and assign joint values
config = robot.zero_configuration()
config.joint_values = joints
# ---------- end fk ----------

# ---- group: VISUALIZATION
visualize = Script(robot=load, config=fk)  # -> out, a
# ---------- visualize: Python ----------
# r: compas_fab, compas_timber, compas_eve
# venv: eic

# 1. If config is set, update the robot
if config:
    robot.update(config)
    
# 2. Draw visual elements
a = robot.scene_object.draw_visual()
# ---------- end visualize ----------
