# Grasshopper definition 02_robot_ik.gh (Grasshopper 1.0.8)

# ---- group: Robotic setup
sand_box_and_table = Brep([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])
preview = CustomPreview(Geometry=sand_box_and_table, Material=ColourSwatch(SwatchColor=RGBA(222, 222, 222, 114)))

# ---- group: Robot
reload = Button()
robot_model = ValueList({"UR10e": "ur10e", "UR10": "ur10"}, selected="UR10e")
ur10e = Python3Script(R=reload, U=robot_model)  # -> M
# ---------- ur10e: Python ----------
# r: compas_fab, compas_timber, compas_eve
# venv: eic

import os

import compas_fab

from compas_robots import RobotModel
from compas_robots.resources import LocalPackageMeshLoader

canvas = ghenv.Component.OnPingDocument()
current_folder = os.path.join(os.path.dirname(canvas.FilePath))

# Locate the URDF file in the same folder
urdf_file = os.path.join(current_folder, U + ".urdf")

# Create robot model from URDF
model = RobotModel.from_urdf_file(urdf_file)


# Also load geometry
loader = LocalPackageMeshLoader(os.path.join(current_folder, "universal_robot"), "ur_description")
model.load_geometry(loader, precision=12)

M = model
# ---------- end ur10e ----------
solver = Python3Script(M=ur10e, S=robot_model)  # -> R
# ---------- solver: Python ----------
# r: compas_fab, compas_timber, compas_eve
# venv: eic

import os

import compas_fab
from compas.scene import Scene
from compas_fab.backends import AnalyticalInverseKinematics
from compas_fab.backends.interfaces import ClientInterface
from compas_fab.robots import Robot
from compas_fab.robots import RobotSemantics

canvas = ghenv.Component.OnPingDocument()
current_folder = os.path.join(os.path.dirname(canvas.FilePath))

# Locate the SRDF file in the current folder
srdf_file = os.path.join(current_folder, 'ur10e.srdf')
semantics = RobotSemantics.from_srdf_file(srdf_file, M)

# Create an IK solver
client = ClientInterface()
client.is_connected = True
client.inverse_kinematics = AnalyticalInverseKinematics(solver=S)

# Create scene object
scene = Scene()
scene_object = scene.add(M)

R = Robot(M, scene_object, client=client, semantics=semantics)
# ---------- end solver ----------

# ---- group: IK
reference_point = Point(Point(0.6212460584, -0.2176326688, 0.4289920734))
tcp = ConstructPlane(Origin=reference_point, XAxis="{0,0,-1}", YAxis=Vector(0, 1, 0))
robot_configuration_type = ValueList({"0", "1", "2", "3", "4", "5", "6", "7"}, selected="2")
ik = Script(R=solver, P=tcp, CT=robot_configuration_type)  # -> C
# ---------- ik: Python ----------
# r: compas_fab, compas_timber, compas_eve
# venv: eic

"""Grasshopper Script"""
import System
import Rhino
import Grasshopper

import math
from compas_rhino.conversions import plane_to_compas_frame

class MyComponent(Grasshopper.Kernel.GH_ScriptInstance):
    def RunScript(self, R, P, CT):
        robot = R
        plane = P
        config_type = CT
        configuration = None

        if robot and robot.client and robot.client.is_connected and plane:
            frame = plane_to_compas_frame(plane)

            configs = robot.iter_inverse_kinematics(frame, start_configuration=None, options={'keep_order': True})
            configuration = list(configs)[config_type]

            if configuration["shoulder_pan_joint"] > math.pi:
                configuration["shoulder_pan_joint"] -= math.pi * 2

            # Fix ARM Flip!
            configuration["shoulder_pan_joint"] += math.pi
            configuration["shoulder_lift_joint"] -= math.pi * 2

#            elif configuration["shoulder_pan_joint"] < math.pi:
#                configuration["shoulder_pan_joint"] += math.pi * 2

        return configuration
# ---------- end ik ----------

# ---- group: VISUALIZATION
visualize_robot = Script(robot=solver, configuration=ik)  # -> out, visual, collision, collision_meshes, attached_meshes, frames, base_frame, ee_frame
# ---------- visualize_robot: Python ----------
# r: compas_fab, compas_timber, compas_eve
# venv: eic

import System
import Rhino
import Grasshopper

import time

from compas.geometry import Frame
from compas.geometry import Transformation
from compas.scene import SceneObject
from compas_ghpython import create_id
from compas_rhino.conversions import frame_to_rhino_plane
from scriptcontext import sticky as st

from compas_fab.backends import BackendFeatureNotSupportedError
from compas_fab.robots import PlanningScene


class MyComponent(Grasshopper.Kernel.GH_ScriptInstance):
    def RunScript(self,
            robot,
            group,
            configuration,
            show_visual,
            show_collision,
            show_frames,
            show_base_frame,
            show_end_effector_frame,
            show_cm,
            show_acm):

        visual = None
        collision = None
        collision_meshes = None
        attached_meshes = None
        frames = None
        base_frame = None
        ee_frame = None

        if robot:
            show_visual = True if show_visual is None else show_visual
            show_cm = True if show_cm is None else show_cm
            show_acm = True if show_acm is None else show_acm
            configuration = configuration or robot.zero_configuration()

            robot.update(configuration, visual=show_visual, collision=show_collision)
            compas_frames = robot.transformed_frames(configuration, group)

            if show_visual:
                visual = robot.scene_object.draw_visual()

            if show_collision:
                collision = robot.scene_object.draw_collision()

            if show_base_frame:
                base_compas_frame = compas_frames[0]
                base_frame = frame_to_rhino_plane(base_compas_frame)

            if show_end_effector_frame:
                options = dict(solver="model")
                if robot.attached_tool:
                    options["link"] = robot.attached_tool.connected_to

                ee_compas_frame = robot.forward_kinematics(configuration, group, options=options)
                ee_frame = frame_to_rhino_plane(ee_compas_frame)

            if show_frames:
                frames = []
                for compas_frame in compas_frames[1:]:
                    frame = frame_to_rhino_plane(compas_frame)
                    frames.append(frame)

            cached_scene_key = f"cached_scene_{ghenv.Component.InstanceGuid}"

            if show_cm or show_acm:
                cached_scene = st.get(cached_scene_key)
                if not cached_scene:
                    cached_scene = {"time": 0}

                # expire cache if the component has not been executed in the last 2 seconds
                # this allows to slide through a list of configurations
                # without triggering refreshes of the scene in the middle of it
                if time.time() - cached_scene["time"] > 2:
                    update_scene = True
                else:
                    update_scene = False

                if update_scene:
                    scene = PlanningScene(robot)
                    try:
                        scene = robot.client.get_planning_scene()
                    except BackendFeatureNotSupportedError:
                        print("The selected backend does not support displaying collision meshes. Feature disabled")
                        scene = None
                        show_cm = False
                        show_acm = False

                if update_scene and show_cm:
                    collision_meshes = []

                    for co in scene.world.collision_objects:
                        header = co.header
                        frame_id = header.frame_id
                        cms = co.to_collision_meshes()

                        for cm in cms:
                            if cm.frame != Frame.worldXY():
                                t = Transformation.from_frame(cm.frame)
                                mesh = cm.mesh.transformed(t)
                            else:
                                mesh = cm.mesh

                            collision_meshes.extend(SceneObject(mesh).draw())

                        cached_scene["cm"] = collision_meshes

                collision_meshes = cached_scene.get("cm", [])

                if update_scene and show_acm:
                    attached_meshes = []

                    for aco in scene.robot_state.attached_collision_objects:
                        for acm in aco.to_attached_collision_meshes():
                            frame_id = aco.object["header"]["frame_id"]
                            frame = robot.forward_kinematics(configuration, options=dict(link=frame_id))
                            t = Transformation.from_frame(frame)

                            # Local CM frame
                            if acm.collision_mesh.frame and acm.collision_mesh.frame != Frame.worldXY():
                                t = t * Transformation.from_frame(acm.collision_mesh.frame)

                            mesh = acm.collision_mesh.mesh.transformed(t)

                            attached_meshes.extend(SceneObject(mesh).draw())

                    cached_scene["acm"] = attached_meshes

                attached_meshes = cached_scene.get("acm", [])

                cached_scene["time"] = time.time()
                st[cached_scene_key] = cached_scene

        return (
            visual,
            collision,
            collision_meshes,
            attached_meshes,
            frames,
            base_frame,
            ee_frame,
        )
# ---------- end visualize_robot ----------
