# Grasshopper definition 03_sand_design.gh (Grasshopper 1.0.8)

# ---- group: Robotic setup
sand_box_and_table = Brep([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])
preview = CustomPreview(Geometry=sand_box_and_table, Material=ColourSwatch(SwatchColor=RGBA(222, 222, 222, 114)))

# ---- group: Robot
reload = Button()
robot_model = ValueList({"UR10e": "ur10e", "UR10": "ur10"}, selected="UR10e")
ur10e = Python3Script(R=reload, U=robot_model)  # -> M
# ---------- ur10e: Python ----------
# r: compas_fab, compas_timber, compas_eve
# venv: eic

import os

import compas_fab

from compas_robots import RobotModel
from compas_robots.resources import LocalPackageMeshLoader

canvas = ghenv.Component.OnPingDocument()
current_folder = os.path.join(os.path.dirname(canvas.FilePath))

# Locate the URDF file in the same folder
urdf_file = os.path.join(current_folder, U + ".urdf")

# Create robot model from URDF
model = RobotModel.from_urdf_file(urdf_file)


# Also load geometry
loader = LocalPackageMeshLoader(os.path.join(current_folder, "universal_robot"), "ur_description")
model.load_geometry(loader, precision=12)

M = model
# ---------- end ur10e ----------
solver = Python3Script(M=ur10e, S=robot_model)  # -> R
# ---------- solver: Python ----------
# r: compas_fab, compas_timber, compas_eve
# venv: eic

import os

import compas_fab
from compas.scene import Scene
from compas_fab.backends import AnalyticalInverseKinematics
from compas_fab.backends.interfaces import ClientInterface
from compas_fab.robots import Robot
from compas_fab.robots import RobotSemantics

canvas = ghenv.Component.OnPingDocument()
current_folder = os.path.join(os.path.dirname(canvas.FilePath))

# Locate the SRDF file in the current folder
srdf_file = os.path.join(current_folder, 'ur10e.srdf')
semantics = RobotSemantics.from_srdf_file(srdf_file, M)

# Create an IK solver
client = ClientInterface()
client.is_connected = True
client.inverse_kinematics = AnalyticalInverseKinematics(solver=S)

# Create scene object
scene = Scene()
scene_object = scene.add(M)

R = Robot(M, scene_object, client=client, semantics=semantics)
# ---------- end solver ----------

# ---- group: toolhead
point = Point(Point(0.09420441032, -7.584409795e-05, -0.2279541738))
mesh = Mesh(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)
tcp = ConstructPlane(Origin=point, XAxis=Vector(1, 0, 0), YAxis=Vector(0, 1, 0))
attach_tool = Script(robot=solver, visual_mesh=mesh, tcf_plane=tcp, connected_to="flange")  # -> robot; inputs visual_mesh: Mesh, tcf_plane: Plane
# ---------- attach_tool: Python ----------
# r: compas_fab, compas_timber, compas_eve
# venv: eic

import System
import Rhino
import Grasshopper

from compas.geometry import Frame
from compas_rhino.conversions import mesh_to_compas
from compas_rhino.conversions import plane_to_compas_frame
from ghpythonlib.componentbase import executingcomponent as component

from compas_fab.robots import Tool


class MyComponent(Grasshopper.Kernel.GH_ScriptInstance):
    def RunScript(self,
            robot,
            visual_mesh: Rhino.Geometry.Mesh,
            collision_mesh,
            tcf_plane: Rhino.Geometry.Plane,
            group,
            connected_to):

        if robot and robot.client and robot.client.is_connected and visual_mesh:
            if not collision_mesh:
                collision_mesh = visual_mesh

            c_visual_mesh = mesh_to_compas(visual_mesh)
            c_collision_mesh = mesh_to_compas(collision_mesh)

            if not tcf_plane:
                frame = Frame.worldXY()
            else:
                frame = plane_to_compas_frame(tcf_plane)
            tool = Tool(c_visual_mesh, frame, c_collision_mesh, connected_to=connected_to)

            robot.attach_tool(tool, group)

        return robot
# ---------- end attach_tool ----------

# ---- group: Robot configuration
robot_configuration_type = ValueList({"0", "1", "2", "3", "4", "5", "6", "7"}, selected="2")

# ---- group: Global parameters
speed_0_to_80_mm_s_max = Panel("20")
zone_blend_radius_mm = Panel("10")
acceleration_mm_s = Panel("10")

# ---- group: I/O Continuous Print
value = Panel("1")
do_num = Panel("0")
value_2 = Panel("0")

# ---- group: Home position / Scanning
reference_point = Point(Point(0.651073194, 0.01404171417, 0.6266659301))
wating_time_s = Slider(5, range=0..10000)
tcp_2 = ConstructPlane(Origin=reference_point, XAxis=Vector(1, 0, 0), YAxis=Vector(0, 1, 0))
ik = Script(
    R=attach_tool,
    P=tcp_2,
    CT=robot_configuration_type,
    S=speed_0_to_80_mm_s_max,
    A=acceleration_mm_s,
    B=zone_blend_radius_mm)  # -> C
# ---------- ik: Python ----------
# r: compas_fab, compas_timber, compas_eve
# venv: eic

"""Grasshopper Script"""
import System
import Rhino
import Grasshopper

import math
from compas_rhino.conversions import plane_to_compas_frame

class MyComponent(Grasshopper.Kernel.GH_ScriptInstance):
    def RunScript(self, R, P, M, CT, S, A, B):
        robot = R
        plane = P
        motion_type = M or "Linear"
        config_type = CT
        speed = S
        accel = A
        blend = B
        configuration = None
        
        if motion_type not in ("Joint", "Linear"):
            raise ValueError("Invalid motion type selected")

        if robot and robot.client and robot.client.is_connected and plane:
            frame = plane_to_compas_frame(plane)

            configs = robot.iter_inverse_kinematics(frame, start_configuration=None, options={'keep_order': True})
            configuration = list(configs)[config_type]
            configuration.motion_type = motion_type
            configuration.speed = float(speed) / 1000.
            configuration.accel = float(accel) / 1000.
            configuration.blend = float(blend) / 1000.

            if configuration["shoulder_pan_joint"] > math.pi:
                configuration["shoulder_pan_joint"] -= math.pi * 2

            # Fix ARM Flip!
            configuration["shoulder_pan_joint"] += math.pi
            configuration["shoulder_lift_joint"] -= math.pi * 2

#            elif configuration["shoulder_pan_joint"] < math.pi:
#                configuration["shoulder_pan_joint"] += math.pi * 2

        return configuration
# ---------- end ik ----------
wait = Script(T=wating_time_s)  # -> C
# ---------- wait: Python ----------
# r: compas_fab, compas_timber, compas_eve
# venv: eic

import System
import Rhino
import Grasshopper

import rhinoscriptsyntax as rs

class WaitCommand(object):
    def __init__(self, wait_time):
        self.wait_time = wait_time
    def __str__(self):
        return "Wait({} seconds)".format(self.wait_time)
    def command(self):
        return "wait"
    def to_command_data(self):
        return {"command": self.command(), "wait_time": self.wait_time}

class MyComponent(Grasshopper.Kernel.GH_ScriptInstance):
    def RunScript(self, T):
        C = WaitCommand(T)
        return C
# ---------- end wait ----------

# ----
# SPEED
pt = Point(Point(0.5199696654, 0.2621618718, 0.3843155639))
Y = UnitY(Factor=Slider(0.5, range=0..0.5))
neg = Negative(Value=Y)
move = Move(Geometry=pt, Motion=neg)  # -> Geometry, Transform
ln = Line(StartPoint=pt, EndPoint=move.Geometry)
divide = DivideCurve(Curve=ln, Count=12, Kinks=False)  # -> Points, Tangents, Parameters
pt_2 = Point(divide.Points)

# ---- group: Incremental speed
max_speed_mm_s = Panel("80")
min_speed_mm_s = Panel("10")
lng = ListLength(List=pt_2)
dom = ConstructDomain(DomainStart=min_speed_mm_s, DomainEnd=max_speed_mm_s)
range = Range(Domain=dom, Steps=expr("x-1", lng))

# ---- group: Planes
pl = ConstructPlane(Origin=pt_2, XAxis=Vector(1, 0, 0), YAxis=Vector(0, 1, 0))

# ----
ik_2 = Script(R=attach_tool, P=pl, CT=robot_configuration_type, S=speed_0_to_80_mm_s_max, A=acceleration_mm_s, B=zone_blend_radius_mm)  # -> C; same code as ik

# ---- group: Targets to plug
targets = Data(ik_2)

# ----
# IO
curve = Curve(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)
divide_2 = DivideCurve(Curve=curve, Count=12, Kinks=False)  # -> Points, Tangents, Parameters
pt_3 = Point(divide_2.Points)
set_io = Script(S=value, V=do_num)  # -> C
# ---------- set_io: Python ----------
# r: compas_fab, compas_timber, compas_eve
# venv: eic

import System
import Rhino
import Grasshopper

import rhinoscriptsyntax as rs

class SetIOCommand(object):
    def __init__(self, signal, value):
        self.signal = int(signal)
        self.value = True if value == "1" else False

    def __str__(self):
        return "Set Digital IO (signal={}, value={})".format(self.signal, self.value)

    def command(self):
        return "set_digital_io"
        
    def to_command_data(self):
        return {"command": self.command(), "signal": self.signal, "value": self.value}

class MyComponent(Grasshopper.Kernel.GH_ScriptInstance):
    def RunScript(self, S, V):
        C = SetIOCommand(S, V)
        return C
# ---------- end set_io ----------
set_io_2 = Script(S=value, V=value_2)  # -> C; same code as set_io

# ---- group: Planes
pl_2 = ConstructPlane(Origin=pt_3, XAxis=Vector(1, 0, 0), YAxis=Vector(0, 1, 0))

# ----
ik_3 = Script(
    R=attach_tool,
    P=pl_2,
    CT=robot_configuration_type,
    S=speed_0_to_80_mm_s_max,
    A=acceleration_mm_s,
    B=zone_blend_radius_mm)  # -> C; same code as ik
insert_items = InsertItems(List=ik_3, Item=set_io, Indices="1", Wrap=True)
entwine = Entwine(Branch00=insert_items, Branch01=set_io_2, FlattenInputs=True)  # -> flatten(Result)

# ---- group: Targets to plug
targets_2 = Data(entwine)

# ----
entwine_2 = Entwine(Branch00=wait, Branch01=targets_2, Branch02=ik, FlattenInputs=True)  # -> flatten(Result)
filter = Script(P=entwine_2)  # -> C, D; inputs P: list
# ---------- filter: Python ----------
# r: compas_fab, compas_timber, compas_eve
# venv: eic

from compas_robots import Configuration

program = P

configs = []
for i in program:
    if isinstance(i, Configuration):
        configs.append(i)
        
C = configs

D = "0 To {}".format(len(C) - 1)
# ---------- end filter ----------

# ---- group: SIMULATION
percent = Slider(0, range=0..100)
panel = Panel("0 To 100")

# ----
remap_numbers = RemapNumbers(Value=percent, Source=panel, Target=filter.D)  # -> Mapped, Clipped

# ---- group: SIMULATION (continued)
list_item = ListItem(List=filter.C, Index=remap_numbers.Mapped, Wrap=True)
visualize_robot = Script(robot=attach_tool, configuration=list_item)  # -> visual, collision, collision_meshes, attached_meshes, frames, base_frame, ee_frame
# ---------- visualize_robot: Python ----------
# r: compas_fab, compas_timber, compas_eve
# venv: eic

import System
import Rhino
import Grasshopper

import time

from compas.geometry import Frame
from compas.geometry import Transformation
from compas.scene import SceneObject
from compas_ghpython import create_id
from compas_rhino.conversions import frame_to_rhino_plane
from scriptcontext import sticky as st

from compas_fab.backends import BackendFeatureNotSupportedError
from compas_fab.robots import PlanningScene


class MyComponent(Grasshopper.Kernel.GH_ScriptInstance):
    def RunScript(self,
            robot,
            group,
            configuration,
            show_visual,
            show_collision,
            show_frames,
            show_base_frame,
            show_end_effector_frame,
            show_cm,
            show_acm):

        visual = None
        collision = None
        collision_meshes = None
        attached_meshes = None
        frames = None
        base_frame = None
        ee_frame = None

        if robot:
            show_visual = True if show_visual is None else show_visual
            show_cm = True if show_cm is None else show_cm
            show_acm = True if show_acm is None else show_acm
            configuration = configuration or robot.zero_configuration()

            robot.update(configuration, visual=show_visual, collision=show_collision)
            compas_frames = robot.transformed_frames(configuration, group)

            if show_visual:
                visual = robot.scene_object.draw_visual()

            if show_collision:
                collision = robot.scene_object.draw_collision()

            if show_base_frame:
                base_compas_frame = compas_frames[0]
                base_frame = frame_to_rhino_plane(base_compas_frame)

            if show_end_effector_frame:
                options = dict(solver="model")
                if robot.attached_tool:
                    options["link"] = robot.attached_tool.connected_to

                ee_compas_frame = robot.forward_kinematics(configuration, group, options=options)
                ee_frame = frame_to_rhino_plane(ee_compas_frame)

            if show_frames:
                frames = []
                for compas_frame in compas_frames[1:]:
                    frame = frame_to_rhino_plane(compas_frame)
                    frames.append(frame)

            cached_scene_key = f"cached_scene_{ghenv.Component.InstanceGuid}"

            if show_cm or show_acm:
                cached_scene = st.get(cached_scene_key)
                if not cached_scene:
                    cached_scene = {"time": 0}

                # expire cache if the component has not been executed in the last 2 seconds
                # this allows to slide through a list of configurations
                # without triggering refreshes of the scene in the middle of it
                if time.time() - cached_scene["time"] > 2:
                    update_scene = True
                else:
                    update_scene = False

                if update_scene:
                    scene = PlanningScene(robot)
                    try:
                        scene = robot.client.get_planning_scene()
                    except BackendFeatureNotSupportedError:
                        print("The selected backend does not support displaying collision meshes. Feature disabled")
                        scene = None
                        show_cm = False
                        show_acm = False

                if update_scene and show_cm:
                    collision_meshes = []

                    for co in scene.world.collision_objects:
                        header = co.header
                        frame_id = header.frame_id
                        cms = co.to_collision_meshes()

                        for cm in cms:
                            if cm.frame != Frame.worldXY():
                                t = Transformation.from_frame(cm.frame)
                                mesh = cm.mesh.transformed(t)
                            else:
                                mesh = cm.mesh

                            collision_meshes.extend(SceneObject(mesh).draw())

                        cached_scene["cm"] = collision_meshes

                collision_meshes = cached_scene.get("cm", [])

                if update_scene and show_acm:
                    attached_meshes = []

                    for aco in scene.robot_state.attached_collision_objects:
                        for acm in aco.to_attached_collision_meshes():
                            frame_id = aco.object["header"]["frame_id"]
                            frame = robot.forward_kinematics(configuration, options=dict(link=frame_id))
                            t = Transformation.from_frame(frame)

                            # Local CM frame
                            if acm.collision_mesh.frame and acm.collision_mesh.frame != Frame.worldXY():
                                t = t * Transformation.from_frame(acm.collision_mesh.frame)

                            mesh = acm.collision_mesh.mesh.transformed(t)

                            attached_meshes.extend(SceneObject(mesh).draw())

                    cached_scene["acm"] = attached_meshes

                attached_meshes = cached_scene.get("acm", [])

                cached_scene["time"] = time.time()
                st[cached_scene_key] = cached_scene

        return (
            visual,
            collision,
            collision_meshes,
            attached_meshes,
            frames,
            base_frame,
            ee_frame,
        )
# ---------- end visualize_robot ----------

# ----
geometry = Geometry(visualize_robot.ee_frame)

deg = Script(C=list_item)  # -> out
# ---------- deg: Python ----------
from __future__ import print_function
import math

for name in C.joint_names:
    print("{:<20}: {:.2f}".format(name, math.degrees(C[name])))
# ---------- end deg ----------
panel_2 = Panel(deg)
