# Grasshopper definition 01_basic_timber_exercise.gh (Grasshopper 1.0.8)

# ----
# Reciprocal Frame units
# Task Description: > Goal: Use the parametric definition of a Reciprocal Frame Unit (`RFUnit`) representing the fundamental building block of reciprocal frame structures and materialize it with compas_timber. An RF Unit is a 2D representation of the closed circuit of rods in an RF Structure. It's enclosed by a polygonal shape and it has exactly one connection point on each of its edges.
# 
# - Materialize it with `compas_timber` detecting the cycles automatically
# - Use two types of connections: TButtJoint and XLapJoint
# - Topics: compas_timber model, beams and connections
number_slider = Slider(6, range=3..20)
rf_unit = Python3Script(
    sides=number_slider,
    radius=Slider(1.5, range=0.1..3),
    start_eccentricity=Slider(0.206, range=-0.5..0.5),
    end_eccentricity=Slider(0.004, range=-0.5..0.5),
    overlap=Slider(0.199, range=0..1))  # -> segment_lines, shape_edges; inputs sides: Int32
# ---------- rf_unit: Python ----------
# r: compas_timber
# venv: eic

from compas.geometry import Line
from compas.geometry import Point
from compas.geometry import Polygon
from compas.geometry import Vector
from compas.geometry import intersection_line_line
from compas_rhino.conversions import line_to_rhino_curve

class ConnectionPoint:
    def __init__(self, point: Point = None, parameter: float = None, vector: Vector = None):
        self.point = point
        self.parameter = parameter
        self.vector = vector


class RodSegment:
    def __init__(self, start: Point, end: Point):
        self.start = start
        self.end = end
        self.rod = None

    @property
    def line(self) -> Line:
        return Line(self.start, self.end)


class RFUnit:
    def __init__(self, shape: Polygon, start_eccentricity=0.0, end_eccentricity=0.0, overlap=0.0):
        self.shape = shape                              # The polygonal shape inscribing the unit
        self.start_eccentricity = start_eccentricity    # Offset distance for the line start points
        self.end_eccentricity = end_eccentricity        # Offset distance for the line end points
        self.overlap = overlap                          # Overlap of the rods beyond the intersection point
        self.segments = []  # List of segment objects representing the unit's rods
        self.connection_points = []  # List of RFConnectionPoint

    @property
    def centroid(self) -> Point:
        return self.shape.centroid

    @property
    def edges(self) -> list[Line]:
        return self.shape.lines

    def generate_segments(self):
        self.segments = []
        self.connection_points = []  # Reset connection points

        for edge in self.edges:
            midpoint = edge.midpoint  # Calculate midpoint of the edge

            # Calculate the normal vector to the edge
            edge_vector = Vector.from_start_end(edge.start, edge.end)

            # Calculate eccentricities
            start = self.centroid + edge_vector * self.start_eccentricity
            end = midpoint + edge_vector * self.end_eccentricity

            # Extend the line inwards
            start = start - Vector.from_start_end(start, end)

            rod_segment = RodSegment(start, end)

            self.segments.append(rod_segment)

            # Store the connection point
            _point, param = edge.closest_point(end, return_parameter=True)
            vector = Vector.from_start_end(start, end).unitized()
            connection = ConnectionPoint(end, param, vector)
            self.connection_points.append(connection)

    # [CHALLENGE 01] The following function is the main part of the solution for challenge 01
    def adjust_segments(self, overlap=None):
        overlap = overlap if overlap is not None else self.overlap  # Ensure overlap is not None

        adjusted_segments = []

        num_segments = len(self.segments)
        for i in range(num_segments):
            # Get a pair of segments (current and next, wrapping around)
            segment = self.segments[i]
            next_segment = self.segments[(i + 1) % num_segments]

            # Find the intersection between the current rod and the next rod
            intersection = intersection_line_line((segment.start, segment.end), (next_segment.start, next_segment.end))

            if not intersection or intersection[0] is None:
                print(f"Warning: No intersection found between Rod {i} and Rod {(i + 1) % num_segments}.")
                adjusted_segments.append(segment)  # Keep original rod if no intersection
                continue

            # Use the first intersection point
            intersection_point = Point(*intersection[0])

            # Extend the rod from the intersection point with the specified overlap
            segment_vector = Vector.from_start_end(segment.start, intersection_point).unitized()
            extended_start = intersection_point + segment_vector * -overlap

            # Update the segment's start point
            segment.start = extended_start

            # Store the adjusted rod
            adjusted_segments.append(segment)

        # Replace the old rods with the adjusted ones
        self.segments = adjusted_segments


if __name__ == "__main__":
    # Create a polygon
    polygon = Polygon.from_sides_and_radius_xy(sides, radius)

    # Create RF unit
    unit = RFUnit(polygon, start_eccentricity=start_eccentricity, end_eccentricity=end_eccentricity, overlap=overlap)
    unit.generate_segments()
    unit.adjust_segments()

    shape_edges = [line_to_rhino_curve(edge) for edge in unit.edges]
    segment_lines = [line_to_rhino_curve(segment.line) for segment in unit.segments]
# ---------- end rf_unit ----------

unit_z = UnitZ(Factor=1)
ct_model = Python3Script(lines=rf_unit.segment_lines, width=Slider(0.06, range=0.01..1.1), height=Slider(0.08, range=0.01..1.1), z_vector=unit_z)  # -> geo; inputs lines: list of Line, z_vector: Vector3d
# ---------- ct_model: Python ----------
# r: compas_timber
# venv: eic

from compas_rhino.conversions import line_to_compas
from compas_rhino.conversions import vector_to_compas
from compas_timber.connections import XLapJoint, TButtJoint
from compas_timber.elements import Beam
from compas_timber.model import TimberModel

# 1. Convert the Z vector from Rhino to COMPAS
# [..ADD YOUR CODE HERE..] 

# 2. Create a new TimberModel()
# [..ADD YOUR CODE HERE..] 

# 3. For each input line...
# [..ADD YOUR CODE HERE..] 
    # 4. Convert the line to COMPAS and create a Beam.from_centerline() for it
    # [..ADD YOUR CODE HERE..] 
    # 5. Add the beam to the model
    # [..ADD YOUR CODE HERE..] 


# 6. Iterate over model's beams in pairs (wrapping around the last element)
# [..ADD YOUR CODE HERE..] 

    # 7. And create joints between each pair. Choose TButtJoint or XLapJoint types.
    # [..ADD YOUR CODE HERE..] 

# 8. Process all joinery
# [..ADD YOUR CODE HERE..] 

# 9. Output the beams' geometry for visualization
# [..ADD YOUR CODE HERE..]
# ---------- end ct_model ----------
