# Grasshopper definition 02_ct_house.gh (Grasshopper 1.0.8)

ct_wallpopulatorconfigset = Script(stud_spacing="700", beam_width="100", sheeting_outside=Toggle(False), sheeting_inside=Toggle(False))  # -> Options; inputs stud_spacing: Double, beam_width: Double, custom_dimensions: list, joint_overrides: list
# ---------- ct_wallpopulatorconfigset: Python ----------
# r: compas_fab, compas_timber, compas_eve
# venv: eic

from Grasshopper.Kernel import GH_RuntimeMessageLevel

import System
import Rhino
import Grasshopper
import rhinoscriptsyntax as rs
from compas_timber.connections import JointTopology
from compas_timber.design import LConnectionDetailA
from compas_timber.design import TConnectionDetailA
from compas_timber.design import WallPopulatorConfigurationSet

class WallPopulatorConfigSetComponent(Grasshopper.Kernel.GH_ScriptInstance):
    DEFAULT_DETAILS = {JointTopology.TOPO_L: LConnectionDetailA(), JointTopology.TOPO_T: TConnectionDetailA()}

    def RunScript(self,
            stud_spacing: float,
            beam_width: float,
            sheeting_outside,
            sheeting_inside,
            lintel_posts,
            edge_stud_offset,
            custom_dimensions: System.Collections.Generic.List[object],
            joint_overrides: System.Collections.Generic.List[object]):
        
        if not stud_spacing:
            self.AddRuntimeMessage(GH_RuntimeMessageLevel.Warning, "Input parameter 'Stud Spacing' failed to collect data")
        if not beam_width:
            self.AddRuntimeMessage(GH_RuntimeMessageLevel.Warning, "Input parameter 'Beam Width' failed to collect data")

        if not (stud_spacing and beam_width):
            return

        dims = None
        if custom_dimensions:
            dims = {}
            for item in custom_dimensions:
                for key, val in item.items():
                    dims[key] = val

        config_set = WallPopulatorConfigurationSet.default(stud_spacing, beam_width)
        config_set.connection_details = self.DEFAULT_DETAILS

        if dims is not None:
            config_set.custom_dimensions = dims
        if sheeting_inside is not None:
            config_set.sheeting_inside = sheeting_inside
        if sheeting_outside is not None:
            config_set.sheeting_outside = sheeting_outside
        if lintel_posts is not None:
            config_set.lintel_posts = lintel_posts
        if edge_stud_offset is not None:
            config_set.edge_stud_offset = edge_stud_offset
        if joint_overrides is not None:
            config_set.joint_overrides = joint_overrides
        return config_set
# ---------- end ct_wallpopulatorconfigset ----------
surface = Surface([<surface referenced from the Rhino model> x2])
ct_slab = Script(surface=surface, thickness="140", config_set=ct_wallpopulatorconfigset, flip_direction=Toggle(False))  # -> Slab, Geometry; inputs surface: list of Brep, thickness: list of Double, config_set: list
# ---------- ct_slab: Python ----------
# r: compas_fab, compas_timber, compas_eve
# venv: eic

import System
import Rhino
import Grasshopper

import rhinoscriptsyntax as rs
from compas.geometry import Brep
from compas.scene import Scene
from compas_timber.design import ContainerDefinition
from compas_timber.elements import Slab

from Grasshopper.Kernel import GH_RuntimeMessageLevel

class MyComponent(Grasshopper.Kernel.GH_ScriptInstance):
    def RunScript(self,
            surface: System.Collections.Generic.List[Rhino.Geometry.Brep],
            thickness: System.Collections.Generic.List[float],
            config_set: System.Collections.Generic.List[object],
            flip_direction):
        # minimum inputs required
        if not surface:
            self.AddRuntimeMessage(GH_RuntimeMessageLevel.Warning, "Input parameter 'Surface' failed to collect data")
        if not thickness:
            self.AddRuntimeMessage(GH_RuntimeMessageLevel.Warning, "Input parameter 'Thickness' failed to collect data")

        if not surface or not thickness:
            return

        if not config_set:
            config_set = [None]

        scene = Scene()
        containers = []
        # check list lengths for consistency
        N = len(surface)
        if len(thickness) not in (1, N):
            self.AddRuntimeMessage(Error, " In 'T' I need either one or the same number of inputs as the Crv parameter.")

        # duplicate data if None or single value
        if len(thickness) != N:
            thickness = [thickness[0] for _ in range(N)]

        if len(config_set) != N:
            config_set = [config_set[0] for _ in range(N)]

        for srf, t, c_s in zip(surface, thickness, config_set):
            wall = Slab.from_brep(Brep.from_native(srf), t)
            if flip_direction:
                wall.rotate()

            containers.append(ContainerDefinition(wall, c_s))
            scene.add(wall.geometry)

        geo = scene.draw()

        return containers, geo
# ---------- end ct_slab ----------

ct_wallpopulatorconfigset_2 = Script(stud_spacing="700", beam_width="100", sheeting_outside=Toggle(False), sheeting_inside=Toggle(False))  # -> Options; inputs stud_spacing: Double, beam_width: Double, custom_dimensions: list, joint_overrides: list; same code as ct_wallpopulatorconfigset
surface_2 = Surface([<surface referenced from the Rhino model> x10])
ct_wall = Script(surface=surface_2, thickness="200", config_set=ct_wallpopulatorconfigset_2)  # -> Wall, Geometry; inputs surface: list of Brep, thickness: list of Double, config_set: list
# ---------- ct_wall: Python ----------
# r: compas_fab, compas_timber, compas_eve
# venv: eic

import System
import Rhino
import Grasshopper

import rhinoscriptsyntax as rs

from compas.geometry import Brep
from compas.scene import Scene
from compas_timber.design import ContainerDefinition
from compas_timber.elements import Wall

from Grasshopper.Kernel import GH_RuntimeMessageLevel

class WallComponent(Grasshopper.Kernel.GH_ScriptInstance):
    def RunScript(self,
            surface: System.Collections.Generic.List[Rhino.Geometry.Brep],
            thickness: System.Collections.Generic.List[float],
            config_set: System.Collections.Generic.List[object]):
        # minimum inputs required
        if not surface:
            self.AddRuntimeMessage(GH_RuntimeMessageLevel.Warning, "Input parameter 'Surface' failed to collect data")
        if not thickness:
            self.AddRuntimeMessage(GH_RuntimeMessageLevel.Warning, "Input parameter 'Thickness' failed to collect data")

        if not surface or not thickness:
            return

        if not config_set:
            config_set = [None]

        scene = Scene()
        containers = []
        # check list lengths for consistency
        N = len(surface)
        if len(thickness) not in (1, N):
            self.AddRuntimeMessage(GH_RuntimeMessageLevel.Error, " In 'T' I need either one or the same number of inputs as the Crv parameter.")

        # duplicate data if None or single value
        if len(thickness) != N:
            thickness = [thickness[0] for _ in range(N)]

        if len(config_set) != N:
            config_set = [config_set[0] for _ in range(N)]

        for srf, t, c_s in zip(surface, thickness, config_set):
            wall = Wall.from_brep(Brep.from_native(srf), t)

            containers.append(ContainerDefinition(wall, c_s))
            scene.add(wall.geometry)

        geo = scene.draw()

        return containers, geo
# ---------- end ct_wall ----------

curve = Curve([<curve referenced from the Rhino model> x2])
category = Data("stud")
curve_2 = Curve(<curve referenced from the Rhino model>)
category_2 = Data("ridge")
curve_3 = Curve([<curve referenced from the Rhino model> x2])
category_3 = Data("mauerlat")
curve_4 = Curve([<curve referenced from the Rhino model> x10])
category_4 = Data("rafter")
ct_beam = Script(centerline=curve_2, width="100", height="200", category=category_2)  # -> Beam, Blank; inputs centerline: list, z_vector: list of Vector3d, width: list of Double, height: list of Double, category: list of String
# ---------- ct_beam: Python ----------
# r: compas_fab, compas_timber, compas_eve
# venv: eic
import System
import Rhino
import Grasshopper

import rhinoscriptsyntax as rs
from compas.scene import Scene
from compas_rhino.conversions import line_to_compas
from compas_rhino.conversions import vector_to_compas
from Rhino import RhinoDoc

from compas_timber.elements import Beam as CTBeam
from compas_timber.ghpython.rhino_object_name_attributes import update_rhobj_attributes_name

from Grasshopper.Kernel import GH_RuntimeMessageLevel

class Beam_fromCurve(Grasshopper.Kernel.GH_ScriptInstance):
    def RunScript(self,
            centerline: System.Collections.Generic.List[object],
            z_vector: System.Collections.Generic.List[Rhino.Geometry.Vector3d],
            width: System.Collections.Generic.List[float],
            height: System.Collections.Generic.List[float],
            category: System.Collections.Generic.List[str],
            updateRefObj):

        # minimum inputs required
        if not centerline:
            self.AddRuntimeMessage(GH_RuntimeMessageLevel.Warning, "Input parameter 'Centerline' failed to collect data")
        if not width:
            length = self._get_centerline_length(centerline)
            width = [length / 20]
        if not height:
            length = self._get_centerline_length(centerline)
            height = [length / 10]

        # reformat unset parameters for consistency
        if not z_vector:
            z_vector = [None]
        if not category:
            category = [None]

        beams = []
        blanks = []
        scene = Scene()

        if centerline and height and width:
            # check list lengths for consistency
            N = len(centerline)
            if len(z_vector) not in (0, 1, N):
                self.AddRuntimeMessage(GH_RuntimeMessageLevel.Error, " In 'ZVector' I need either none, one or the same number of inputs as the Crv parameter.")
            if len(width) not in (1, N):
                self.AddRuntimeMessage(GH_RuntimeMessageLevel.Error, " In 'W' I need either one or the same number of inputs as the Crv parameter.")
            if len(height) not in (1, N):
                self.AddRuntimeMessage(GH_RuntimeMessageLevel.Error, " In 'H' I need either one or the same number of inputs as the Crv parameter.")
            if len(category) not in (0, 1, N):
                self.AddRuntimeMessage(GH_RuntimeMessageLevel.Error, " In 'Category' I need either none, one or the same number of inputs as the Crv parameter.")

            # duplicate data if None or single value
            if len(z_vector) != N:
                z_vector = [z_vector[0] for _ in range(N)]
            if len(width) != N:
                width = [width[0] for _ in range(N)]
            if len(height) != N:
                height = [height[0] for _ in range(N)]
            if len(category) != N:
                category = [category[0] for _ in range(N)]

            for line, z, w, h, c in zip(centerline, z_vector, width, height, category):
                guid, geometry = self._get_guid_and_geometry(line)
                rhino_line = rs.coerceline(geometry)
                line = line_to_compas(rhino_line)

                z = vector_to_compas(z) if z else None
                beam = CTBeam.from_centerline(centerline=line, width=w, height=h, z_vector=z)
                beam.attributes["rhino_guid"] = str(guid) if guid else None
                beam.attributes["category"] = c
                if updateRefObj and guid:
                    update_rhobj_attributes_name(guid, "width", str(w))
                    update_rhobj_attributes_name(guid, "height", str(h))
                    update_rhobj_attributes_name(guid, "zvector", str(list(beam.frame.zaxis)))
                    update_rhobj_attributes_name(guid, "category", c)

                beams.append(beam)
                scene.add(beam.blank)

        blanks = scene.draw()

        return beams, blanks

    def _get_guid_and_geometry(self, line):
        # internalized curves and GH geometry will not have persistent GUIDs, referenced Rhino objects will
        # type hint on the input has to be 'ghdoc' for this to work
        guid = None
        geometry = line
        rhino_obj = RhinoDoc.ActiveDoc.Objects.FindId(line)
        if rhino_obj:
            guid = line
            geometry = rhino_obj.Geometry
        return guid, geometry

    def _get_centerline_length(self, centerline):
        centerline_length = []
        for i in centerline:
            centerline_length.append(rs.CurveLength(i))
        if centerline_length:
            length_average = sum(centerline_length) / len(centerline_length)
        else:
            length_average = 1
        return length_average
# ---------- end ct_beam ----------
ct_beam_2 = Script(centerline=curve_3, width="150", height="150", category=category_3)  # -> Beam, Blank; inputs centerline: list, z_vector: list of Vector3d, width: list of Double, height: list of Double, category: list of String; same code as ct_beam
ct_beam_3 = Script(centerline=curve_4, width="100", height="150", category=category_4)  # -> Beam, Blank; inputs centerline: list, z_vector: list of Vector3d, width: list of Double, height: list of Double, category: list of String; same code as ct_beam
ct_beam_4 = Script(centerline=curve, width="100", height="200", category=category)  # -> Beam, Blank; inputs centerline: list, z_vector: list of Vector3d, width: list of Double, height: list of Double, category: list of String; same code as ct_beam

category_5 = Data("mauerlat")
category_6 = Data("stud")
category_7 = Data("ridge")
category_8 = Data("mauerlat")
category_9 = Data("rafter")
category_10 = Data("ridge")
ct_joint_rule = Script(main_beam_category=category_5, cross_beam_category=category_10)  # -> TDovetailJoint
# ---------- ct_joint_rule: Python ----------
# r: compas_fab, compas_timber, compas_eve
# venv: eic
import System
import Rhino
import Grasshopper

import rhinoscriptsyntax as rs

from Grasshopper.Kernel import GH_RuntimeMessageLevel
from compas_timber.connections import Joint
from compas_timber.connections import LButtJoint
from compas_timber.design import CategoryRule

class MyComponent(Grasshopper.Kernel.GH_ScriptInstance):
    def RunScript(self, main_beam_category, cross_beam_category):
        return CategoryRule(LButtJoint, main_beam_category, cross_beam_category)
# ---------- end ct_joint_rule ----------
ct_joint_rule_2 = Script(main_beam_category=category_6, cross_beam_category=category_7)  # -> LButtJoint; same code as ct_joint_rule
ct_joint_rule_3 = Script(main_beam_category=category_8, cross_beam_category=category_9, flip_lap_side=Toggle(True))  # -> XLapJoint
# ---------- ct_joint_rule_3: Python ----------
# r: compas_fab, compas_timber, compas_eve
# venv: eic
import System
import Rhino
import Grasshopper

import rhinoscriptsyntax as rs

from Grasshopper.Kernel import GH_RuntimeMessageLevel
from compas_timber.connections import Joint
from compas_timber.connections import XLapJoint
from compas_timber.design import CategoryRule

class MyComponent(Grasshopper.Kernel.GH_ScriptInstance):
    def RunScript(self,
            main_beam_category,
            cross_beam_category,
            flip_lap_side,
            cut_plane_bias,
            max_distance):
        return CategoryRule(XLapJoint, main_beam_category, cross_beam_category, max_distance=max_distance, flip_lap_side=flip_lap_side)
# ---------- end ct_joint_rule_3 ----------

ct_model = Script(Containers=flatten([ct_slab.Slab, ct_wall.Wall]), MaxDistance="200", CreateGeometry=Toggle(True))  # -> Model, Geometry, DebugInfo; inputs Elements: list, Containers: list, JointRules: list, Features: list, MaxDistance: Double, CreateGeometry: Boolean
# ---------- ct_model: Python ----------
# r: compas_fab, compas_timber, compas_eve
# venv: eic

import System
import Rhino
import Grasshopper

import rhinoscriptsyntax as rs

from compas.scene import Scene
from compas.tolerance import TOL


from compas_timber.connections import JointTopology
from compas_timber.connections import LMiterJoint
from compas_timber.connections import TButtJoint
from compas_timber.connections import XLapJoint
from compas_timber.design import DebugInfomation
from compas_timber.design import JointRule
from compas_timber.design import WallPopulator
from compas_timber.elements import Beam
from compas_timber.elements import Plate
from compas_timber.errors import FeatureApplicationError
from compas_timber.model import TimberModel

JOINT_DEFAULTS = {
    JointTopology.TOPO_X: XLapJoint,
    JointTopology.TOPO_T: TButtJoint,
    JointTopology.TOPO_L: LMiterJoint,
}

# workaround for https://github.com/gramaziokohler/compas_timber/issues/280
TOL.absolute = 1e-6

from Grasshopper.Kernel import GH_RuntimeMessageLevel

class ModelComponent(Grasshopper.Kernel.GH_ScriptInstance):
    def RunScript(self,
            Elements: System.Collections.Generic.List[object],
            Containers: System.Collections.Generic.List[object],
            JointRules: System.Collections.Generic.List[object],
            Features: System.Collections.Generic.List[object],
            MaxDistance: float,
            CreateGeometry: bool):
        
        if not Elements:
            self.AddRuntimeMessage(GH_RuntimeMessageLevel.Warning, "Input parameter Beams failed to collect data")
        if not JointRules:
            self.AddRuntimeMessage(GH_RuntimeMessageLevel.Warning, "Input parameter JointRules failed to collect data")
        if not (Elements or Containers):  # shows beams even if no joints are found
            return
        if MaxDistance is None:
            MaxDistance = TOL.ABSOLUTE  # compared to calculted distance, so shouldn't be just 0.0

        # clear Nones
        Containers = [c for c in Containers or [] if c is not None]

        Model = TimberModel()
        debug_info = DebugInfomation()

        ##### Adding elements #####
        if Elements:
            for element in Elements:
                # prepare elements for downstream processing
                element.reset()
                Model.add_element(element)

        for index, c_def in enumerate(Containers):
            slab = c_def.slab
            Model.add_group_element(slab, name=slab.name + str(index))

        Model.connect_adjacent_walls()

        ##### Wall populating #####
        config_sets = [c_def.config_set for c_def in Containers]
        populators = []
        if any(config_sets):
            populators = WallPopulator.from_model(Model, config_sets)

        handled_pairs = []
        wall_joint_definitions = []

        for populator, slab in zip(populators, list(Model.slabs)):
            elements = populator.create_elements()
            Model.add_elements(elements, parent=slab.name)
            joint_definitions = populator.create_joint_definitions(elements, MaxDistance)
            wall_joint_definitions.extend(joint_definitions)
            for j_def in joint_definitions:
                element_a, element_b = j_def.elements
                handled_pairs.append({element_a, element_b})

        ##### Handle joinery #####
        joint_defs, unmatched_pairs = JointRule.joints_from_beams_and_rules(Model.beams, JointRules or [], MaxDistance, handled_pairs=handled_pairs)
        if unmatched_pairs:
            for pair in unmatched_pairs:
                self.AddRuntimeMessage(GH_RuntimeMessageLevel.Warning, "No joint rule found for beams {} and {}".format(list(pair)[0].key, list(pair)[1].key))  # TODO: add to debug_info

        if wall_joint_definitions:
            joint_defs += wall_joint_definitions

        # apply reversed. later joints in orginal list override ealier ones
        for joint_def in joint_defs[::-1]:
            joint_def.joint_type.create(Model, *joint_def.elements, **joint_def.kwargs)

        # checks elements compatibility and applies extensions and features resulting from joints
        bje = Model.process_joinery()
        if bje:
            debug_info.add_joint_error(bje)

        ##### Handle user features #####
        if Features:
            feature_errors = []
            features = [f for f in Features if f is not None]
            for f_def in features:
                if not f_def.elements:
                    self.AddRuntimeMessage(GH_RuntimeMessageLevel.Warning, "Features defined in model must have elements defined. Features without elements will be ignored")
                    continue

                for element in f_def.elements:
                    try:
                        element.add_features(f_def.feature_from_element(element))
                    except FeatureApplicationError as ex:
                        feature_errors.append(ex)

            for error in feature_errors:
                debug_info.add_feature_error(error)

        ##### Visualization #####
        Geometry = None
        scene = Scene()
        for element in Model.elements():
            if CreateGeometry:
                scene.add(element.geometry)
                if getattr(element, "debug_info", False):
                    debug_info.add_feature_error(element.debug_info)
            else:
                if isinstance(element, Beam) or isinstance(element, Plate):
                    scene.add(element.blank)
                else:
                    scene.add(element.geometry)

        if debug_info.has_errors:
            self.AddRuntimeMessage(GH_RuntimeMessageLevel.Warning, "Error found during joint creation. See DebugInfo output for details.")

        Geometry = scene.draw()
        return Model, Geometry, debug_info
# ---------- end ct_model ----------

defauls = Script()  # -> Rules
# ---------- defauls: Python ----------
# r: compas_fab, compas_timber, compas_eve
# venv: eic
import System
import Rhino
import Grasshopper

import rhinoscriptsyntax as rs

from compas_timber.connections import JointTopology
from compas_timber.connections import LMiterJoint
from compas_timber.connections import TButtJoint
from compas_timber.connections import XLapJoint
from compas_timber.design import TopologyRule

from Grasshopper.Kernel import GH_RuntimeMessageLevel

class DefaultJointRule(Grasshopper.Kernel.GH_ScriptInstance):
    def RunScript(self):
        topoRules = []
        topoRules.append(TopologyRule(JointTopology.TOPO_L, LMiterJoint))
        topoRules.append(TopologyRule(JointTopology.TOPO_T, TButtJoint))
        topoRules.append(TopologyRule(JointTopology.TOPO_X, XLapJoint))

        return topoRules
# ---------- end defauls ----------
ct_model_2 = Script(
    Elements=flatten([ct_beam.Beam, ct_beam_2.Beam, ct_beam_3.Beam, ct_beam_4.Beam]),
    JointRules=flatten([defauls, ct_joint_rule_2, ct_joint_rule_3, ct_joint_rule]),
    MaxDistance="100",
    CreateGeometry=Toggle(True))  # -> Model, Geometry, DebugInfo; inputs Elements: list, Containers: list, JointRules: list, Features: list, MaxDistance: Double, CreateGeometry: Boolean; same code as ct_model

geometry = Geometry(ct_model.Geometry)
geometry_2 = Geometry(ct_model_2.Geometry)
